# Grasshopper definition CurveApply.gh (Grasshopper 1.0.8)

# ---- group: Inputs
crv = Curve(<curve referenced from the Rhino model>)

# ----
geomin = Geometry()
bbox = BoundingBox(Content=crv, Plane=PlaneXY(0, 0, 0))  # -> Box, Box_2
morph = BoxMorph(Geometry=crv, Reference=bbox.Box, Target=geomin)
geomout = Geometry(morph)
