# Grasshopper definition CutFloorplates.gh (Grasshopper 1.0.8)

center_uv = Point(Point(0.5, 0.5, 0))
geomin = Geometry(<brep referenced from the Rhino model>)

# ---- group: Inputs
verticality_tolerance = Slider(0.8, range=0..1)
floor_height = Slider(3.5, range=2..6)

# ----
bbox = BoundingBox(Content=geomin, Plane=PlaneXY(0, 0, 0))  # -> Box, Box_2
debrep = DeconstructBrep(Brep=geomin)  # -> Faces, Edges, Vertices
debox = DeconstructBox(Box=bbox.Box)  # -> Plane, X, Y, Z
dedomain = DeconstructDomain(Domain=debox.Z)  # -> Start, End
evalsrf = EvaluateSurface(Surface=reparameterize(debrep.Faces), Point=center_uv)  # -> Point, Normal, UDirection, VDirection, Frame
subtraction = Subtraction(A=dedomain.End, B=dedomain.Start)
devector = DeconstructVector(Vector=evalsrf.Normal)  # -> XComponent, YComponent, ZComponent
division = Division(A=subtraction, B=floor_height)
abs = Absolute(Value=devector.ZComponent)
round = Round(Number=division)  # -> Nearest, Floor, Ceiling
filter_sides = SmallerThan(FirstNumber=abs, SecondNumber=verticality_tolerance)  # -> SmallerThan, OrEqualTo
addition = Addition(A=round.Floor, B=1)
series = Series(Start=0, Step=floor_height, Count=addition)
dispatch_side_faces = Dispatch(List=debrep.Faces, DispatchPattern=filter_sides.SmallerThan)  # -> ListA, ListB
pt = ConstructPoint(XCoordinate=0, YCoordinate=0, ZCoordinate=series)
xy = XYPlane(Origin=pt)
sec = BrepPlane(Brep=geomin, Plane=xy)  # -> Curves, Points
boundary = BoundarySurfaces(Edges=sec.Curves)
last_item = ListItem(List=boundary, Index=-1, Wrap=True)

# ---- group: Outputs
facade = Geometry(dispatch_side_faces.ListA)
geomout = Geometry(boundary)
