# Grasshopper definition DaylightFactor.gh (Grasshopper 1.0.8)
# plug-ins: Flexibility

# ---- group: Inputs
context = Geometry([<extrusion referenced from the Rhino model> x3])
offset_workplane = Slider(0.8, range=0..2)
min_df = Slider(0, range=0..100)
max_df = Slider(100, range=0..100)
grid_size = Slider(5, range=0.1..5)
run = BooleanToggle(True)
flip_normals = BooleanToggle(False)

# ----
geomin = Geometry([<surface referenced from the Rhino model> x16])
lift_floors = Move(Geometry=geomin, Motion=Vector(0, 0, 0.01))  # -> Geometry, Transform
flip_surfaces = Flip(Surface=lift_floors.Geometry, Run=flip_normals, Size=1)
area = Area(Geometry=lift_floors.Geometry)  # -> Area, Centroid
brepsinc = PointInBreps(Brep=context, Point=area.Centroid, Strict=False)  # -> Inside, Index
view_type_skyview = Panel("4")
item = ListItem(List=brepsinc.Index, Index=0, Wrap=True)
exclude_shell_building = CullIndex(List=context, Indices=item, Wrap=True)

# ---- group: Logic
legendpar = LBLegendParameters(min=min_df, max=max_df)  # -> leg_par; plug-in component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
viewpercent = LBViewPercent(
    view_type=view_type_skyview,
    geometry=graft(flip_surfaces),
    context=flatten(exclude_shell_building),
    grid_size=grid_size,
    offset_dist=offset_workplane,
    legend_par=legendpar,
    run=run)  # -> report, points, view_vecs, results, mesh, legend, title, int_mtx; plug-in component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

# ----
mean_df = Average(Input=viewpercent.results)

# ---- group: Outputs
heatmap = LBSpatialHeatmap(values=viewpercent.results, mesh=viewpercent.mesh, legend_par=legendpar)  # -> mesh, legend, title, colors, legend_par, vis_set; plug-in component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
df_results = Number(viewpercent.results)
geomout = Geometry(heatmap.mesh)
