# Grasshopper definition DiamondFacade.gh (Grasshopper 1.0.8)
# plug-ins: LunchBox

# ---- group: Inputs
diamond_size = Slider(4, range=1..20)
frame_thickness = Slider(0.1, range=0..0.5)
frame_offset_scale = Slider(0.85, range=0.5..0.99)
facade = Geometry()

# ---- group: Logic
break_brep = DeconstructBrep(Brep=facade)  # -> Faces, Edges, Vertices
face_size = Dimensions(Surface=break_brep.Faces)  # -> UDimension, VDimension
calc_u = Expression(x=face_size.UDimension, y=diamond_size, Expression="round(x/y)")
calc_v = Expression(x=face_size.VDimension, y=diamond_size, Expression="round(x/y)")
diamond_panels_logic = DiamondPanels(Surface=simplify(break_brep.Faces), UDivisions=calc_u, VDivisions=calc_v)  # -> DiamondPanels, TriPanels
panel_frame_logic = PanelFrame(Panel=[diamond_panels_logic.DiamondPanels, diamond_panels_logic.TriPanels], ScaleFactor=frame_offset_scale)  # -> PanelFrame, Panel

# ----
geomin = Geometry()
col = Colour()

# ---- group: Outputs
floorplatesout = Geometry(flatten(geomin))
geomout = Geometry(flatten([panel_frame_logic.PanelFrame, floorplatesout]))
windows = Geometry(flatten(panel_frame_logic.Panel))
