# Grasshopper definition Extrude.gh (Grasshopper 1.0.8)

# ---- group: Inputs
extrude_direction = ValueList({"X": 0, "Y": 1, "Z": 2}, selected="X")
extrude_distance = Number()

# ----
geomin = Geometry(<extrusion referenced from the Rhino model>)
gate = StreamGate(Stream=extrude_distance, Gate=extrude_direction)  # -> Target0, Target1, Target2
X = UnitX(Factor=gate.Target0)
Y = UnitY(Factor=gate.Target1)
Z = UnitZ(Factor=gate.Target2)
extr = Extrude(Base=geomin, Direction=[Z, Y, X])

# ---- group: Outputs
geomout = Geometry(extr)
