# Grasshopper definition HopsNodesghx.ghx (Grasshopper 1.0.8)

xy = XYPlane(Origin=Point(0, 0, 0))
cone = Cone(Base=PlaneXY(0, 0, 0), Radius=0.5, Length=1)  # -> Cone, Tip
list = ValueList({"One": 1, "Two": 2, "Three": 2² - 1, "Four": Sqrt(16)}, selected="One")
line = Line(Line((-1.143614895, -26.17263513, 0), (-9.757124359, 41.85762198, 0)))
bool = Boolean(True)
pt = Point(Point(12.15146035, -12.6549847, 0))

# ---- group: Hops Inputs w/ Defaults
get_geometry_default = GetGeometry(cone.Cone, AnnotationTypeFilter=3966, AtLeast=1, AtMost=1, DeleteInput=False, Filter=1074081855, TreeAccess=False)
get_string = GetString("Hello World", AtLeast=1, AtMost=1, TreeAccess=False)
get_plane = GetPlane(xy, AtLeast=1, AtMost=1, Realtime=True, TreeAccess=False)
get_line = GetLine(line, AtLeast=1, AtMost=1, Realtime=True, TreeAccess=False)
get_boolean = GetBoolean("/mnt/", AtLeast=1, AtMost=1, FalseValue="False", TreeAccess=False, TrueValue="True")
get_file_path = GetFilePath("/mnt/", AtLeast=1, AtMost=1, TreeAccess=False)
get_integer = GetInteger(list, AtLeast=1, AtMost=1, Maximum=2147483647, Minimum=-2147483648, TreeAccess=False)
get_number = GetNumber(Slider(1, range=1..10), AtLeast=1, AtMost=1, Maximum=1.797693135e+308, Minimum=-1.797693135e+308, TreeAccess=False)
get_point = GetPoint(pt, AtLeast=1, AtMost=1, Realtime=True, TreeAccess=False)

# ---- group: Hops Inputs
get_geometry = GetGeometry(AnnotationTypeFilter=3966, AtLeast=1, AtMost=1, DeleteInput=False, Filter=1074081855, TreeAccess=False)
get_string_2 = GetString(AtLeast=1, AtMost=1, TreeAccess=False)
get_plane_2 = GetPlane(AtLeast=1, AtMost=1, Realtime=True, TreeAccess=False)
get_line_2 = GetLine(AtLeast=1, AtMost=1, Realtime=True, TreeAccess=False)
get_boolean_2 = GetBoolean(AtLeast=1, AtMost=1, FalseValue="False", TreeAccess=False, TrueValue="True")
get_file_path_2 = GetFilePath(AtLeast=1, AtMost=1, TreeAccess=False)
get_integer_2 = GetInteger(AtLeast=1, AtMost=1, Maximum=2147483647, Minimum=-2147483648, TreeAccess=False)
get_number_2 = GetNumber(AtLeast=1, AtMost=1, Maximum=1.797693135e+308, Minimum=-1.797693135e+308, TreeAccess=False)
get_point_2 = GetPoint(AtLeast=1, AtMost=1, Realtime=True, TreeAccess=False)

# ---- group: Hops Outputs
c_print = ContextPrint()
c_bake = ContextBake()
