# Grasshopper definition Intersect.ghx (Grasshopper 1.0.8)

geomin = Geometry(<extrusion referenced from the Rhino model>)

# ---- group: Inputs
clash = Geometry()

# ----
sint = SolidIntersection(BrepsA=geomin, BrepsB=clash)

# ---- group: Outputs
geomout = Geometry(sint)
