# Grasshopper definition LadybugCutter.gh (Grasshopper 1.0.8)

epw_link = Panel("https://climate.onebuilding.org/WMO_Region_6_Europe/CHE_Switzerland/BL_Basel-Landschaft/CHE_BL_Basel.Binningen.066010_TMYx.zip")

# ---- group: Inputs
grid_size = Slider(5, range=0..10)
number_slider = Slider(2, range=0..3)
context = Geometry(flatten([<extrusion referenced from the Rhino model> x3]))

# ----
geomin = Geometry(<extrusion referenced from the Rhino model>)
month = Slider(6, range=1..12)
day = Slider(21, range=1..31)
start_hour = Slider(11, range=0..23)
end_hour = Slider(14, range=0..23)
downloadepw = LBDownloadWeather(weather_URL=epw_link)  # -> epw_file, stat_file, ddy_file; plug-in component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
analysisperiod = LBAnalysisPeriod(start_month=month, start_day=day, start_hour=start_hour, end_month=6, end_day=21, end_hour=end_hour)  # -> period, hoys, dates; plug-in component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
importloc = LBImportLocation(epw_file=downloadepw.epw_file)  # -> location; plug-in component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
sunpath = LBSunPath(location=importloc, hoys=analysisperiod.hoys, scale=10)  # -> report, vectors, altitudes, azimuths, hoys, sun_pts, analemma, daily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; plug-in component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
solarenvelope = LBSolarEnvelope(
    geometry=flatten(geomin),
    obstacles=flatten(context),
    vectors=flatten(sunpath.vectors),
    grid_size=grid_size,
    solar_rights=Toggle(True),
    run=True)  # -> report, points, mesh; plug-in component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
mesh = Mesh(solarenvelope.mesh)
pt = Point(solarenvelope.points)
roof_patch = Patch(Points=solarenvelope.points, Spans=Slider(10, range=0..10), Flexibility=10, Trim=True)
area = Area(Geometry=roof_patch)  # -> Area, Centroid
scale = Scale(Geometry=roof_patch, Center=area.Centroid, Factor=Slider(1.5, range=1..2))  # -> Geometry, Transform
Z = UnitZ(Factor=Slider(10000, range=0..10000))
split_building = SplitBrep(Brep=geomin, Cutter=scale.Geometry)
centers = Area(Geometry=split_building)  # -> Area, Centroid
extr = Extrude(Base=scale.Geometry, Direction=Z)
split_building_2 = SplitBrep(Brep=scale.Geometry, Cutter=geomin)
heights = DeconstructPoint(Point=centers.Centroid, System=PlaneXY(0, 0, 0))  # -> XCoordinate, YCoordinate, ZCoordinate
area_2 = Area(Geometry=split_building_2)  # -> Area, Centroid
sort_by_height = SortList(Keys=heights.ZCoordinate, ValuesA=split_building)  # -> Keys, ValuesA
sort = SortList(Keys=area_2.Area, ValuesA=split_building_2)  # -> Keys, ValuesA
bottom_part = ListItem(List=sort_by_height.ValuesA, Index=0, Wrap=True)
item = ListItem(List=sort.ValuesA, Index=number_slider, Wrap=True)
join = BrepJoin(Breps=flatten([bottom_part, item]))  # -> Breps, Closed

# ---- group: Outputs
geomout = Geometry(join.Breps)
