# Grasshopper definition Move.ghx (Grasshopper 1.0.8)

# ---- group: Inputs
factor = Slider(0, range=0..10)

# ----
geomin = Geometry()
Z = UnitZ(Factor=factor)
move = Move(Geometry=geomin, Motion=Z)  # -> Geometry, Transform
geomout = Geometry(move.Geometry)
