# Grasshopper definition SaveText.gh (Grasshopper 1.0.8)

geomin = Geometry()

# ---- group: Inputs
save_file_path = FilePath()
file_content = Text()

# ----
c_script = CSharpScript(path=save_file_path, content=file_content)  # -> out; inputs path: String, content: String
# ---------- c_script: C# ----------
// Grasshopper Script Instance
#region Usings
using System;
using System.Linq;
using System.Collections;
using System.Collections.Generic;
using System.Drawing;

using Rhino;
using Rhino.Geometry;

using Grasshopper;
using Grasshopper.Kernel;
using Grasshopper.Kernel.Data;
using Grasshopper.Kernel.Types;
#endregion

public class Script_Instance : GH_ScriptInstance
{
    #region Notes
    /* 
      Members:
        RhinoDoc RhinoDocument
        GH_Document GrasshopperDocument
        IGH_Component Component
        int Iteration

      Methods (Virtual & overridable):
        Print(string text)
        Print(string format, params object[] args)
        Reflect(object obj)
        Reflect(object obj, string method_name)
    */
    #endregion

    private void RunScript(string path, string content)
    {
        if (!string.IsNullOrEmpty(path))
        {
            System.IO.File.WriteAllText(path, content);
        }
    }
}
# ---------- end c_script ----------
geomout = Geometry(geomin)
