# Grasshopper definition SolidDifference.gh (Grasshopper 1.0.8)

# ---- group: Inputs
difference = Geometry()

# ----
geomin = Geometry()
sdiff = SolidDifference(BrepsA=geomin, BrepsB=difference)
geomout = Geometry(sdiff)
