# Grasshopper definition SubDivide.ghx (Grasshopper 1.0.8)
# plug-ins: LunchBox

# ---- group: Inputs
number_slider = Slider(0, range=0..100)
number_slider_2 = Slider(0, range=0..100)

# ----
geomin = Geometry(<brep referenced from the Rhino model>)
explode = ExplodeObject(Object=geomin, Recursive=False)
diamond = DiamondPanels(Surface=explode, UDivisions=number_slider, VDivisions=number_slider_2)  # -> DiamondPanels, TriPanels
geomout = Geometry(flatten([diamond.DiamondPanels, diamond.TriPanels]))
