# Grasshopper definition SurfaceBoxing.ghx (Grasshopper 1.0.8)

# ---- group: Inputs
z_scale = Slider(1, range=-5..5)
v_count = Slider(10, range=1..50)
u_count = Slider(22, range=1..50)

# ----
geomin = Geometry(<surface referenced from the Rhino model>)
divdom2 = DivideDomain²(Domain=geomin, UCount=u_count, VCount=v_count)
srfbox = SurfaceBox(Surface=geomin, Domain=divdom2, Height=z_scale)
geomout = Geometry(flatten(srfbox))
