# Grasshopper definition Taper.gh (Grasshopper 1.0.8)

# ---- group: Inputs
start_factor = Slider(1, range=0..2)
end_factor = Slider(0.5, range=0..2)

# ----
geomin = Geometry(<extrusion referenced from the Rhino model>)
bbox = BoundingBox(Content=geomin, Plane=PlaneXY(0, 0, 0))  # -> Box, Box_2
corners = BoxCorners(Box=bbox.Box)  # -> CornerA, CornerB, CornerC, CornerD, CornerE, CornerF, CornerG, CornerH
bottom_center = Average(Input=[corners.CornerA, corners.CornerB, corners.CornerC, corners.CornerD])
top_center = Average(Input=[corners.CornerE, corners.CornerF, corners.CornerG, corners.CornerH])
baseradiusref = Distance(PointA=bottom_center, PointB=corners.CornerA)
axisline = Line(StartPoint=bottom_center, EndPoint=top_center)
startval = Multiplication(A=baseradiusref, B=start_factor)
endval = Multiplication(A=baseradiusref, B=end_factor)
tapergeometry = Taper(Geometry=geomin, Axis=axisline, Start=startval, End=endval, Flat=False, Infinite=False, Rigid=False)
previewtaper = CustomPreview(
    Geometry=tapergeometry,
    Material={diffuse=RGB(228, 178, 227), emission=RGB(68, 53, 68), shine=0.5, specular=RGB(255, 254, 255), transparency=0})

# ---- group: Outputs
geomout = Geometry(tapergeometry)
