# Grasshopper definition TestInputs.gh (Grasshopper 1.0.8)

# ---- group: Inputs
slider = Slider(5, range=0..10)
value_list = ValueList({"One": 1, "Two": 2, "Three": 2² - 1, "Four": Sqrt(16)}, selected="One")
color_swatch = ColourSwatch(SwatchColor=RGB(255, 254, 254))
int = Integer()
num = Number()
point3d = Point(Point(0, 0, 0))
geometry = Geometry()
file_path = FilePath()

# ----
geomin = Geometry(<extrusion referenced from the Rhino model>)

# ---- group: Outputs
geomout = Geometry(geomin)
slider_val = Integer(slider)
int_val = Integer(int)
float_val = Number(num)
point = Point(point3d)
geometry_2 = Geometry(geometry)
color_val = Text(color_swatch)
list_val = Integer(value_list)
selected_path = Text(file_path)
