# Grasshopper definition Twist2.ghx (Grasshopper 1.0.8)

geomin = GetGeometry(AnnotationTypeFilter=3966, AtLeast=1, AtMost=1, DeleteInput=False, Filter=1074081855, TreeAccess=False)
get_integer = GetInteger(AtLeast=1, AtMost=1, Maximum=2147483647, Minimum=-2147483648, TreeAccess=False)
get_point = GetPoint(AtLeast=1, AtMost=1, Realtime=True, TreeAccess=False)
Z = UnitZ(Factor=1)
move = Move(Geometry=get_point, Motion=Z)  # -> Geometry, Transform
rad = Radians(Degrees=get_integer)
ln = Line(StartPoint=get_point, EndPoint=move.Geometry)
twist = Twist(Geometry=geomin, Axis=ln, Angle=rad, Infinite=True, Rigid=False)
geomout = ContextBake(Content=twist)
c_print = ContextPrint(Text=get_integer)
c_print_2 = ContextPrint(Text=get_integer)
